# Grasshopper definition simplify-network.gh (Grasshopper 1.0.8)
# plug-ins: Human, eleFront

# ---- group: Gis Roads
# Network
unprocessed_network_values = Data(simplify(Tree({0}: ["Major -Collector Street", RGB(249, 213, 4)], {1}: ["Sub-Arterial Street", RGB(255, 127, 0)], {2}: ["Sub-Arterial Street", RGB(255, 127, 0)], {3}: ["Primary Arterial Street", RGB(255, 0, 0)], {4}: ["Minor- Collector Street", RGB(20, 74, 168)], {5}: ["Minor- Collector Street", RGB(20, 74, 168)]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)))
unprocessed_network = Data(simplify(graft(Tree({0}: [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], {1}: [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], {2}: [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], {3}: [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], {4}: [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], {5}: [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]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))))

# ----
# Simplify Network
unprocessed_street_network_curve = Curve(flatten(unprocessed_network))
values = Data(unprocessed_network_values)
text_join = TextJoin(Text=values, Join="|")  # -> flatten(Result)
network_to_segments = NetworkToSegments(network_as_list=unprocessed_street_network_curve, tolerance=Slider(6, range=0..10))  # -> network_segments, segments_count
duplicate_data = DuplicateData(Data=graft(text_join), Number=graft(network_to_segments.segments_count), Order=True)  # -> flatten(Data)
network_split = NetworkSplit(network=network_to_segments.network_segments, tolerance=Slider(0.1, range=0..0.1))  # -> network_split, split_count
duplicate_data_2 = DuplicateData(Data=graft(duplicate_data), Number=graft(network_split.split_count), Order=True)  # -> flatten(Data)
network_reduce = NetworkReduce(network=network_split.network_split, tolerance=Slider(10, range=0..100))  # -> street_network, segments_index
list_item = ListItem(List=duplicate_data_2, Index=network_reduce.segments_index, Wrap=True)
network_smooth = NetworkSmooth(network=network_reduce.street_network, radius=Slider(15, range=0..100))  # -> network_smooth, segments_index
list_item_2 = ListItem(List=list_item, Index=network_smooth.segments_index, Wrap=True)
network_reduce_2 = NetworkReduce(network=network_smooth.network_smooth, tolerance=Slider(15, range=0..100))  # -> street_network, segments_index
list_item_3 = ListItem(List=list_item_2, Index=network_reduce_2.segments_index, Wrap=True)
network_smooth_2 = NetworkSmooth(network=network_reduce_2.street_network, radius=Slider(15, range=0..100))  # -> network_smooth, segments_index
list_item_4 = ListItem(List=list_item_3, Index=network_smooth_2.segments_index, Wrap=True)
network_reduce_3 = NetworkReduce(network=network_smooth_2.network_smooth, tolerance=Slider(15, range=0..100))  # -> street_network, segments_index
list_item_5 = ListItem(List=list_item_4, Index=network_reduce_3.segments_index, Wrap=True)
network_dead_ends = NetworkDeadEnds(network=network_reduce_3.street_network, iterations=Slider(1, range=0..10), maximum_length=Slider(25, range=0..100))  # -> network_2, segments_index
list_item_6 = ListItem(List=list_item_5, Index=network_dead_ends.segments_index, Wrap=True)

network_split_2 = NetworkSplit(network=network_dead_ends.network_2, tolerance=Slider(0.1, range=0..0.1))  # -> network_split, split_count
duplicate_data_3 = DuplicateData(Data=graft(list_item_6), Number=graft(network_split_2.split_count), Order=True)  # -> flatten(Data)

text_split = TextSplit(Text=duplicate_data_3, Separators="|")  # -> simplify(Result)
simplifiednetworkattributes = Data(text_split)
simplifiednetwork = Curve(network_split_2.network_split)

# ---- group: Report
unprocessed_street_network_curve_2 = Curve(flatten(unprocessed_network))
simplifiednetwork_2 = Curve(simplifiednetwork)
list_length = ListLength(List=unprocessed_street_network_curve_2)
list_length_2 = ListLength(List=simplifiednetwork_2)
concatenate = Concatenate(FragmentA="Original Count:", FragmentB=list_length, FragmentD="Simplified Count: ", FragmentE=list_length_2)
report = Data(concatenate)
panel = Panel(report)

# ---- group: Attributes Check
simplyfiednetwork = Curve(simplifiednetwork)
simplifiednetworkattributes_2 = Data(simplifiednetworkattributes)
unprocessed_network_2 = Data(unprocessed_network)
unprocessed_network_values_2 = Data(simplify(unprocessed_network_values))
curve_middle = CurveMiddle(Curve=flatten(unprocessed_network_2))
curve_middle_2 = CurveMiddle(Curve=simplyfiednetwork)
list_item_7 = ListItem(List=simplifiednetworkattributes_2, Index=0, Wrap=True)  # -> flatten(Item), flatten(Item1)
list_item_8 = ListItem(List=unprocessed_network_values_2, Index=0, Wrap=True)  # -> flatten(Item)
layer = Data(list_item_7.Item)
concatenate_2 = Concatenate(FragmentA="SiplifiedNetwork::", FragmentB=layer)
text_tag = TextTag(Location=curve_middle_2, Text=layer, Colour=ColourSwatch(SwatchColor=RGB(0, 255, 13)))
text_tag_2 = TextTag(Location=curve_middle, Text=list_item_8, Colour=ColourSwatch(SwatchColor=RGB(123, 0, 255)))
layer_2 = Data(concatenate_2)
color = Data(list_item_7.Item1)

# ---- group: SubGraphs Check
simplifiednetwork_3 = Curve(simplifiednetwork)
network_subgraphs = NetworkSubgraphs(network=simplifiednetwork_3)  # -> report, main_graph, sub_graph
panel_2 = Panel(network_subgraphs.report)
previewlw = CustomPreviewLineweights(
    Geometry=network_subgraphs.main_graph,
    Shader=ColourSwatch(SwatchColor=RGB(0, 60, 255)),
    Thickness=Slider(5, range=0..10),
    Absolute=False)
previewlw_2 = CustomPreviewLineweights(
    Geometry=network_subgraphs.sub_graph,
    Shader=ColourSwatch(SwatchColor=RGB(255, 81, 0)),
    Thickness=Slider(5, range=0..10),
    Absolute=False)

# ---- group: Detect Changes
unprocessed_street_network_curve_3 = Curve(flatten(unprocessed_network))
simplifiednetwork_4 = Curve(simplifiednetwork)
explode = Explode(Curve=unprocessed_street_network_curve_3, Recursive=True)  # -> flatten(Segments), Vertices
network_detect_changes = NetworkDetectChanges(
    lines_old=explode.Segments,
    lines_new=simplifiednetwork_4,
    resolution=Slider(0.5, range=0..1),
    return_geometry=Toggle(True))  # -> lines_unchanged, lines_added, lines_removed
number_slider = Slider(4, range=0..10)
custom_preview_lineweights = CustomPreviewLineweights(Geometry=network_detect_changes.lines_unchanged, Shader=ColourSwatch(SwatchColor=RGB(0, 0, 0)), Absolute=False)
custom_preview_lineweights_2 = CustomPreviewLineweights(
    Geometry=network_detect_changes.lines_added,
    Shader=ColourSwatch(SwatchColor=RGB(64, 255, 0)),
    Thickness=number_slider,
    Absolute=False)
custom_preview_lineweights_3 = CustomPreviewLineweights(
    Geometry=network_detect_changes.lines_removed,
    Shader=ColourSwatch(SwatchColor=RGB(255, 0, 0)),
    Thickness=number_slider,
    Absolute=False)

# ---- group: Bake
geo = Data(simplifiednetwork)
layer_3 = Data(layer_2)
color_2 = Data(color)
elefront_layer = EleFrontLayer(FullPath=layer_3, DisplayColour=color_2)
elefront_attributes = EleFrontAttributes(Layer=elefront_layer, ColourSource="Layer")
bake_objects = BakeObjects(Geometry=geo, Attributes=elefront_attributes, Bake=Button(), createGroups=False)  # -> Message, Ghosts

# ==== cluster NetworkToSegments: Explodes Network to segments and turns curves to lines based on the prided tolerance (max deviation from original curve). The cluster also filters out duplicate lines
network_as_list = ClusterInput()  # Network as List
tolerance = ClusterInput()
number = Number(tolerance)
curve = Curve(network_as_list)
clean = CleanTree(RemoveNulls=True, RemoveInvalid=True, RemoveEmpty=False, Tree=curve)
curvetype_c = CSharpScript(N=graft(clean))  # -> out, Crv, Ln, Polyln; inputs N: list of Curve
# ---------- curvetype_c: C# ----------
    List<Curve> ln = new List<Curve>();
    List<Curve> polyln = new List<Curve>();
    List<Curve> crv = new List<Curve>();

    foreach(Curve c in N)
    {
      if (c.IsLinear())
        ln.Add(c);
      else if(c.IsPolyline())
        polyln.Add(c);
      else
        crv.Add(c);
    }

    Crv = crv;
    Ln = ln;
    Polyln = polyln;
# ---------- end curvetype_c ----------
clean_2 = CleanTree(RemoveNulls=True, RemoveInvalid=True, RemoveEmpty=invert(False), Tree=curvetype_c.Crv)  # -> simplify(graft(Tree))
clean_3 = CleanTree(RemoveNulls=True, RemoveInvalid=True, RemoveEmpty=invert(False), Tree=curvetype_c.Ln)  # -> simplify(graft(Tree))
clean_4 = CleanTree(RemoveNulls=True, RemoveInvalid=True, RemoveEmpty=invert(False), Tree=curvetype_c.Polyln)  # -> simplify(graft(Tree))
topoly = CurveToPolyline(Curve=clean_2, ToleranceDistance=number, ToleranceAngle=0)  # -> Polyline, Segments
explode = Explode(Curve=clean_4, Recursive=True)  # -> simplify(Segments), Vertices
explode_2 = Explode(Curve=topoly.Polyline, Recursive=True)  # -> Segments, Vertices
list_length = ListLength(List=clean_3)  # -> simplify(Length)
list_length_2 = ListLength(List=explode.Segments)  # -> simplify(Length)
list_length_3 = ListLength(List=explode_2.Segments)  # -> simplify(Length)
merge = Merge(Data1=simplify(clean_3), Data2=simplify(explode.Segments), Data3=simplify(explode_2.Segments))  # -> flatten(Result)
merge_2 = Merge(Data1=simplify(list_length), Data2=simplify(list_length_2), Data3=simplify(list_length_3))  # -> flatten(Result)
duplicatelines_c = CSharpScript(lines=merge)  # -> out, uniqueLinesOut, duplicateIndicesOut; inputs lines: list of Line
# ---------- duplicatelines_c: C# ----------
    Dictionary<string, Line> uniqueLinesDict = new Dictionary<string, Line>();
    List<int> duplicateIndices = new List<int>();

    for (int i = 0; i < lines.Count; i++)
    {
      Line currentLine = lines[i];
      string key = LineToStringKey(currentLine);

      if (uniqueLinesDict.ContainsKey(key))
      {
        duplicateIndices.Add(i);
      }
      else
      {
        uniqueLinesDict[key] = currentLine;
      }
    }

    uniqueLinesOut = new List<Line>(uniqueLinesDict.Values);
    duplicateIndicesOut = duplicateIndices;
# ---------- duplicatelines_c: C# additional code ----------
  private string LineToStringKey(Line line)
  {
    // Define a fixed precision to ensure uniqueness up to a certain decimal point
    const string format = "F6"; // up to 6 decimal places
    
    // Sort the points based on X, then Y, then Z to ensure consistency
    Point3d start, end;
    if (ComparePoints(line.From, line.To) < 0)
    {
      start = line.From;
      end = line.To;
    }
    else
    {
      start = line.To;
      end = line.From;
    }
    
    return start.X.ToString(format) + "," + start.Y.ToString(format) + "," + start.Z.ToString(format) + "|" + end.X.ToString(format) + "," + end.Y.ToString(format) + "," + end.Z.ToString(format);
  }
  private int ComparePoints(Point3d a, Point3d b)
  {
    if (a.X != b.X) return a.X.CompareTo(b.X);
    if (a.Y != b.Y) return a.Y.CompareTo(b.Y);
    return a.Z.CompareTo(b.Z);
  }
# ---------- end duplicatelines_c ----------
cull_index = CullIndex(List=merge_2, Indices=duplicatelines_c.duplicateIndicesOut, Wrap=True)  # -> simplify(List)
shift_paths = ShiftPaths(Data=cull_index, Offset=-1)
ns = Line(duplicatelines_c.uniqueLinesOut)
integer = Integer(shift_paths)
network_segments = ClusterOutput(ns)  # Segmented Network
segments_count = ClusterOutput(integer)  # Number of Polyline Segments

# ==== cluster NetworkSplit: Splits network at all intersections
tolerance = ClusterInput()
network = ClusterInput()  # Network as Lines
line = Line(flatten(network))
number = Number(tolerance)
split_network_c = CSharpScript(N=line, T=number)  # -> out, Ns, SplitCounts; inputs N: list of Line, T: Double; disabled
# ---------- split_network_c: C# ----------
using System;
using System.Collections;
using System.Collections.Generic;

using Rhino;
using Rhino.Geometry;

using Grasshopper;
using Grasshopper.Kernel;
using Grasshopper.Kernel.Data;
using Grasshopper.Kernel.Types;
using Rhino.Collections;
using Rhino.Geometry.Intersect;


public class Script_Instance : GH_ScriptInstance
{
    private void RunScript(
	List<Line> N,
	double T,
	ref object Ns,
	ref object SplitCounts)
    {
        double tolerance = T;
        var network = new StreetNetwork(N, tolerance);
        List<int> splitCounts;
        Ns = network.GetIntersectedLines(out splitCounts);
        SplitCounts = splitCounts;
    }

    public class StreetNetwork
    {
        private RTree _tree = new RTree();
        private List<Line> _lines = new List<Line>();
        private double _tolerance;

        public StreetNetwork(IEnumerable<Line> lines, double documentTolerance)
        {
            _tolerance = documentTolerance;

            int tag = 0;
            foreach (var line in lines)
            {
                _tree.Insert(line.ToNurbsCurve().GetBoundingBox(false), tag++);
                _lines.Add(line);
            }
        }

        public List<Line> GetIntersectedLines(out List<int> splitCounts)
        {
            var result = new HashSet<Line>();
            splitCounts = new List<int>();

            foreach (var line in _lines)
            {
                var potentialTags = new List<int>();
                _tree.Search(line.ToNurbsCurve().GetBoundingBox(false), (s, args) =>
                {
                    potentialTags.Add(args.Id);
                });

                var splitParameters = new List<double>();
                foreach (var tag in potentialTags)
                {
                    var otherLine = _lines[tag];
                    if (line.From != otherLine.From && line.To != otherLine.To &&
                        line.From != otherLine.To && line.To != otherLine.From)
                    {
                        double a, b;
                        if (Intersection.LineLine(line, otherLine, out a, out b, _tolerance, true))
                        {
                            if (a > 0 && a < 1)
                                splitParameters.Add(a);
                        }
                    }
                }

                splitParameters.Sort();
                if (splitParameters.Count > 0)
                {
                    double lastParam = 0.0;
                    int segmentCount = 0;
                    foreach (var param in splitParameters)
                    {
                        AddSegment(result, new Line(line.PointAt(lastParam), line.PointAt(param)));
                        lastParam = param;
                        segmentCount++;
                    }
                    AddSegment(result, new Line(line.PointAt(lastParam), line.To));
                    segmentCount++;
                    splitCounts.Add(segmentCount);
                }
                else
                {
                    AddSegment(result, line);
                    splitCounts.Add(1);
                }
            }

            return new List<Line>(result);
        }

        private void AddSegment(HashSet<Line> segments, Line line)
        {
            if (line.Length > _tolerance)
            {
                segments.Add(line);
            }
        }
    }
}
# ---------- end split_network_c ----------
# Slower version that works for Rana
split_network_c_2 = CSharpScript(N=line, T=number)  # -> out, Ns, SplitCounts; inputs N: list of Line, T: Double
# ---------- split_network_c_2: C# ----------
#region Usings
using System;
using System.Linq;
using System.Collections;
using System.Collections.Generic;
using System.Drawing;

using Rhino;
using Rhino.Geometry;
using Rhino.Collections;
using Rhino.Geometry.Intersect;

using Grasshopper;
using Grasshopper.Kernel;
using Grasshopper.Kernel.Data;
using Grasshopper.Kernel.Types;
#endregion

public class Script_Instance : GH_ScriptInstance
{
    private void RunScript(
	List<Line> N,
	double T,
	ref object Ns,
	ref object SplitCounts)
    {
        double tolerance = T;
        var network = new StreetNetwork(N, tolerance);
        List<int> splitCounts;
        Ns = network.GetIntersectedLines(out splitCounts);
        SplitCounts = splitCounts;
    }

    public class StreetNetwork
{
    private RTree _tree = new RTree();
    private List<Line> _lines = new List<Line>();
    private double _tolerance;

    public StreetNetwork(IEnumerable<Line> lines, double documentTolerance)
    {
        _tolerance = documentTolerance;

        if (lines == null)
        {
            throw new ArgumentNullException("lines", "The input lines collection cannot be null.");
        }

        int tag = 0;
        foreach (var line in lines)
        {
            if (line != null && line.Length > _tolerance)
            {
                var curve = line.ToNurbsCurve();
                if (curve != null)
                {
                    var bbox = curve.GetBoundingBox(false);
                    _tree.Insert(bbox, tag++);
                    _lines.Add(line);
                }
            }
        }
    }

    public List<Line> GetIntersectedLines(out List<int> splitCounts)
{
    var result = new List<Line>();
    splitCounts = new List<int>();
    var lineComparer = new LineComparer(_tolerance);

    foreach (var line in _lines)
    {
        var potentialTags = new List<int>();
        _tree.Search(line.ToNurbsCurve().GetBoundingBox(false), (s, args) =>
        {
            potentialTags.Add(args.Id);
        });

        var splitParameters = new List<double>();
        foreach (var tag in potentialTags)
        {
            var otherLine = _lines[tag];
            // Skip if it's the same line
            if (IsSameLine(line, otherLine, _tolerance))
                continue;

            double a, b;
            if (Intersection.LineLine(line, otherLine, out a, out b, _tolerance, true))
            {
                // Only add parameters that are clearly within the line (not at endpoints)
                if (a > _tolerance && a < 1 - _tolerance)
                    splitParameters.Add(a);
            }
        }

        splitParameters.Sort();
        // Remove duplicate split parameters within tolerance
        splitParameters = RemoveDuplicateParameters(splitParameters, _tolerance);

        if (splitParameters.Count > 0)
        {
            double lastParam = 0.0;
            int segmentCount = 0;
            foreach (var param in splitParameters)
            {
                AddSegment(result, new Line(line.PointAt(lastParam), line.PointAt(param)), lineComparer);
                lastParam = param;
                segmentCount++;
            }
            AddSegment(result, new Line(line.PointAt(lastParam), line.To), lineComparer);
            segmentCount++;
            splitCounts.Add(segmentCount);
        }
        else
        {
            AddSegment(result, line, lineComparer);
            splitCounts.Add(1);
        }
    }

    return result;
}

private void AddSegment(List<Line> segments, Line line, LineComparer comparer)
{
    if (line.Length > _tolerance)
    {
        // Check if the line already exists in the list
        bool exists = segments.Any(existingLine => comparer.Equals(existingLine, line));
        if (!exists)
        {
            segments.Add(line);
        }
    }
}

    private bool IsSameLine(Line line1, Line line2, double tolerance)
    {
        return (line1.From.DistanceTo(line2.From) <= tolerance && line1.To.DistanceTo(line2.To) <= tolerance) ||
               (line1.From.DistanceTo(line2.To) <= tolerance && line1.To.DistanceTo(line2.From) <= tolerance);
    }

    private List<double> RemoveDuplicateParameters(List<double> parameters, double tolerance)
    {
        if (parameters.Count <= 1) return parameters;

        var result = new List<double>();
        result.Add(parameters[0]);

        for (int i = 1; i < parameters.Count; i++)
        {
            if (Math.Abs(parameters[i] - parameters[i - 1]) > tolerance)
            {
                result.Add(parameters[i]);
            }
        }

        return result;
    }

    private class LineComparer : IEqualityComparer<Line>
    {
        private readonly double _tolerance;

        public LineComparer(double tolerance)
        {
            _tolerance = tolerance;
        }

        public bool Equals(Line x, Line y)
        {
            if (x == null || y == null) return false;
            return (x.From.DistanceTo(y.From) <= _tolerance && x.To.DistanceTo(y.To) <= _tolerance) ||
                   (x.From.DistanceTo(y.To) <= _tolerance && x.To.DistanceTo(y.From) <= _tolerance);
        }

        public int GetHashCode(Line obj)
        {
            if (obj == null) return 0;
            return obj.From.GetHashCode() ^ obj.To.GetHashCode();
        }
    }
}
}
# ---------- end split_network_c_2 ----------
line_2 = Line(split_network_c_2.Ns)
integer = Integer(split_network_c_2.SplitCounts)
network_split = ClusterOutput(line_2)  # Intersected Network
split_count = ClusterOutput(integer)  # Count of Splitted Network Segments

# ==== cluster NetworkReduce: Simplify line chains between crossings without affecting network topology
tolerance = ClusterInput()  # Tolerance (Allowed deviation between original and reduction)
network = ClusterInput()
line = Line(network)
network_to_polylines_c = CSharpScript(N=flatten(line))  # -> out, Np, UsedLineIndexes; inputs N: list of Line
# ---------- network_to_polylines_c: C# ----------
using System;
using System.Collections;
using System.Collections.Generic;
using System.Linq;

using Rhino;
using Rhino.Geometry;

using Grasshopper;
using Grasshopper.Kernel;
using Grasshopper.Kernel.Data;
using Grasshopper.Kernel.Types;

public class Script_Instance : GH_ScriptInstance
{
    private void RunScript(List<Line> N, ref object Np, ref object UsedLineIndexes)
    {
        if (N == null || N.Count == 0)
        {
            AddRuntimeMessage(GH_RuntimeMessageLevel.Error, "Input lines list is null or empty");
            return;
        }

        try
        {
            NetworkProcessor processor = new NetworkProcessor(N, 0.001);
            List<Tuple<Polyline, List<int>>> result = processor.ProcessWithIndexes();

            // Extract polylines
            Np = result.Select(r => r.Item1).ToList();

            // Create a DataTree for the used line indexes
            DataTree<int> usedLineIndexesTree = new DataTree<int>();
            for (int i = 0; i < result.Count; i++)
            {
                var path = new GH_Path(i);
                foreach (var index in result[i].Item2)
                {
                    usedLineIndexesTree.Add(index, path);
                }
            }
            UsedLineIndexes = usedLineIndexesTree;
        }
        catch (Exception ex)
        {
            AddRuntimeMessage(GH_RuntimeMessageLevel.Error, "Error processing network: " + ex.Message);
            Np = null;
            UsedLineIndexes = null;
        }
    }

    // <Custom additional code> 
    public class Point3dEqualityComparer : IEqualityComparer<Point3d>
    {
        private readonly double tolerance;
        private const int BucketSize = 100;

        public Point3dEqualityComparer(double tolerance)
        {
            this.tolerance = tolerance;
        }

        public bool Equals(Point3d x, Point3d y)
        {
            return x.DistanceTo(y) <= tolerance;
        }

        public int GetHashCode(Point3d obj)
        {
            unchecked
            {
                int hash = 17;
                
                long xBucket = (long)(obj.X / (tolerance * BucketSize));
                long yBucket = (long)(obj.Y / (tolerance * BucketSize));
                long zBucket = (long)(obj.Z / (tolerance * BucketSize));
                
                hash ^= (int)(xBucket & 0xFFFFFFFF);
                hash ^= (int)(yBucket & 0xFFFFFFFF) << 8;
                hash ^= (int)(zBucket & 0xFFFFFFFF) << 16;
                
                return hash;
            }
        }
    }

    public class NetworkProcessor
    {
        private readonly List<Line> lines;
        private readonly Dictionary<Point3d, HashSet<Line>> pointToLineMap;
        private readonly Dictionary<Line, int> originalIndexes;
        private readonly double tolerance;

        public NetworkProcessor(List<Line> inputLines, double tolerance)
        {
            this.tolerance = tolerance;
            this.lines = new List<Line>(inputLines);
            this.pointToLineMap = BuildPointToLineMap(inputLines, tolerance);
            this.originalIndexes = new Dictionary<Line, int>(inputLines.Count);

            for (int i = 0; i < inputLines.Count; i++)
            {
                originalIndexes[inputLines[i]] = i;
            }
        }

        private Dictionary<Point3d, HashSet<Line>> BuildPointToLineMap(List<Line> lines, double tolerance)
        {
            var map = new Dictionary<Point3d, HashSet<Line>>(
                lines.Count * 2,
                new Point3dEqualityComparer(tolerance)
            );

            foreach (var line in lines)
            {
                if (!map.TryGetValue(line.From, out HashSet<Line> fromLines))
                {
                    fromLines = new HashSet<Line>();
                    map[line.From] = fromLines;
                }
                fromLines.Add(line);

                if (!map.TryGetValue(line.To, out HashSet<Line> toLines))
                {
                    toLines = new HashSet<Line>();
                    map[line.To] = toLines;
                }
                toLines.Add(line);
            }

            return map;
        }

        public List<Tuple<Polyline, List<int>>> ProcessWithIndexes()
        {
            var result = new List<Tuple<Polyline, List<int>>>();
            var remainingLines = new HashSet<Line>(lines);

            while (remainingLines.Count > 0)
            {
                var currentLine = remainingLines.First();
                var polyline = new Polyline();
                polyline.Add(currentLine.From);
                polyline.Add(currentLine.To);
                
                var usedIndexes = new List<int> { originalIndexes[currentLine] };
                remainingLines.Remove(currentLine);

                ExtendPolylineWithIndexes(polyline, currentLine.To, true, usedIndexes, remainingLines);
                ExtendPolylineWithIndexes(polyline, currentLine.From, false, usedIndexes, remainingLines);

                result.Add(new Tuple<Polyline, List<int>>(polyline, usedIndexes));
            }

            return result;
        }

        private void ExtendPolylineWithIndexes(
            Polyline poly, 
            Point3d point, 
            bool forward, 
            List<int> usedIndexes, 
            HashSet<Line> remainingLines)
        {
            Point3d currentPoint = point;
            
            while (true)
            {
                if (!pointToLineMap.TryGetValue(currentPoint, out HashSet<Line> connectedLines))
                    break;

                var availableLines = connectedLines.Where(l => remainingLines.Contains(l)).ToList();
                if (availableLines.Count != 1)
                    break;

                var nextLine = availableLines[0];
                Point3d nextPoint;

                if (nextLine.From.DistanceTo(currentPoint) <= tolerance)
                    nextPoint = nextLine.To;
                else if (nextLine.To.DistanceTo(currentPoint) <= tolerance)
                    nextPoint = nextLine.From;
                else
                    break;

                if (forward)
                    poly.Add(nextPoint);
                else
                    poly.Insert(0, nextPoint);

                currentPoint = nextPoint;
                usedIndexes.Add(originalIndexes[nextLine]);
                remainingLines.Remove(nextLine);
            }
        }
    }
}
# ---------- end network_to_polylines_c ----------
usedlineindexes = Integer(network_to_polylines_c.UsedLineIndexes)
np = Curve(graft(network_to_polylines_c.Np))
number = Number(tolerance)
c_script = CSharpScript(Polyline=np, PolylineSegmentIndexes=usedlineindexes, Tolerance=number)  # -> out, ReducedPolyline, LeftSegmentIndexes; inputs Polyline: tree of Curve, PolylineSegmentIndexes: tree of Int32, Tolerance: Double
# ---------- c_script: C# usings ----------
using System.Linq;
# ---------- c_script: C# ----------
    // DataTree to store the simplified polylines
    DataTree<Polyline> simplifiedPolylines = new DataTree<Polyline>();
    // DataTree to store the segment indexes that are "left" after simplification
    DataTree<int> leftIndexesTree = new DataTree<int>();

    for (int i = 0; i < Polyline.BranchCount; i++)
    {
      // Get the polyline and segment indexes from the input data tree
      List<Curve> curveList = Polyline.Branch(i);
      List<int> segmentIndexList = PolylineSegmentIndexes.Branch(i);

      // Extract the polyline from the curves
      Polyline polyline;
      curveList[0].TryGetPolyline(out polyline);

      // Simplify the polyline using the Ramer-Douglas-Peucker algorithm
      Polyline simplified = PolylineSimplification(polyline, Tolerance);

      // Find the closest original segments to the average points of the simplified segments
      List<int> keptIndexes = FindClosestSegmentsToAverage(polyline, simplified, segmentIndexList);

      // Store the simplified polyline and left segment indexes in the respective data trees
      simplifiedPolylines.Add(simplified, new GH_Path(i));

      // Add the left segment indexes to the tree in the correct format
      for (int j = 0; j < keptIndexes.Count; j++)
      {
        leftIndexesTree.Add(keptIndexes[j], new GH_Path(i));
      }
    }

    // Set the output parameters
    ReducedPolyline = simplifiedPolylines;
    LeftSegmentIndexes = leftIndexesTree;
  }

  private Polyline PolylineSimplification(Polyline polyline, double tolerance)
  {
    if (polyline == null || polyline.Count < 3)
      return polyline;

    List<Point3d> result = new List<Point3d>();
    RamerDouglasPeucker(polyline.ToList(), tolerance, result);

    return new Polyline(result);
  }

  private void RamerDouglasPeucker(List<Point3d> points, double tolerance, List<Point3d> result)
  {
    if (points.Count < 2)
      return;

    // Find the point with the maximum distance
    double maxDistance = 0;
    int index = 0;
    Line line = new Line(points[0], points[points.Count - 1]);

    for (int i = 1; i < points.Count - 1; i++)
    {
      double distance = line.DistanceTo(points[i], true);
      if (distance > maxDistance)
      {
        index = i;
        maxDistance = distance;
      }
    }

    // If max distance is greater than tolerance, recursively simplify
    if (maxDistance > tolerance)
    {
      List<Point3d> recResults1 = new List<Point3d>();
      List<Point3d> recResults2 = new List<Point3d>();
      List<Point3d> firstHalf = points.GetRange(0, index + 1);
      List<Point3d> secondHalf = points.GetRange(index, points.Count - index);

      RamerDouglasPeucker(firstHalf, tolerance, recResults1);
      RamerDouglasPeucker(secondHalf, tolerance, recResults2);

      result.AddRange(recResults1);
      result.AddRange(recResults2.GetRange(1, recResults2.Count - 1));
    }
    else
    {
      result.Add(points[0]);
      result.Add(points[points.Count - 1]);
    }
# ---------- c_script: C# additional code ----------
  private List<int> FindClosestSegmentsToAverage(Polyline original, Polyline simplified, List<int> originalIndexes)
  {
    List<int> closestIndexes = new List<int>();

    for (int i = 0; i < simplified.Count - 1; i++)
    {
      // Calculate the average point of the simplified segment
      Point3d simplifiedMidPoint = (simplified[i] + simplified[i + 1]) / 2;

      // Find the closest original segment to this average point
      double minDistance = double.MaxValue;
      int closestIndex = -1;

      for (int j = 0; j < original.Count - 1; j++)
      {
        Line originalSegment = new Line(original[j], original[j + 1]);
        double distance = originalSegment.DistanceTo(simplifiedMidPoint, true);

        if (distance < minDistance)
        {
          minDistance = distance;
          closestIndex = originalIndexes[j];
        }
      }

      // Add the closest segment index to the list
      if (closestIndex != -1)
      {
        closestIndexes.Add(closestIndex);
      }
    }

    return closestIndexes;
  }
# ---------- end c_script ----------
reducedpolyline = Data(c_script.ReducedPolyline)
reducedpolyline_2 = Data(c_script.LeftSegmentIndexes)
len = Length(Curve=reducedpolyline)
equals = Equality(FirstNumber=len, SecondNumber="0")  # -> Equality, Inequality
cull = CullPattern(List=reducedpolyline_2, CullPattern=equals.Inequality)  # -> flatten(List)
cull_2 = CullPattern(List=reducedpolyline, CullPattern=equals.Inequality)
explode = Explode(Curve=cull_2, Recursive=True)  # -> flatten(Segments), Vertices
text = Text(explode.Segments)
match_text = MatchText(Text=text, Pattern="Invalid Curve", Case=True)
cull_pattern = CullPattern(List=explode.Segments, CullPattern=invert(match_text))
cull_pattern_2 = CullPattern(List=cull, CullPattern=invert(match_text))
street_network = ClusterOutput(explode.Segments)
segments_index = ClusterOutput(cull_pattern_2)

# ==== cluster NetworkSmooth: Snap line ends
network = ClusterInput()
radius = ClusterInput()
anchor_points = ClusterInput()
use_anchors = ClusterInput()
boolean = Boolean(use_anchors)
line = Line(network)
number = Number(radius)
point = Point(anchor_points)
networksmooth_c = CSharpScript(Network=line, Radius=number, Anchor=point, F=boolean)  # -> out, Ns, OriginalToSimplifiedMap; inputs Network: list of Line, Radius: Double, Anchor: list of Point3d, F: Boolean
# ---------- networksmooth_c: C# usings ----------
using Rhino.Collections;
using System.Threading.Tasks;
# ---------- networksmooth_c: C# ----------
    if (F != true)
    {
      F = false; // Default value
    }

    List<int> originalToSimplifiedMap;
    List<Line> simplifiedNetwork = SimplifyNetwork(Network, Radius, Anchor, F, out originalToSimplifiedMap);

    Ns = simplifiedNetwork;
    OriginalToSimplifiedMap = originalToSimplifiedMap;
# ---------- networksmooth_c: C# additional code ----------
  public List<Line> SimplifyNetwork(List<Line> lines, double radius, List<Point3d> anchorPoints, bool anchorAsMergeOnly, out List<int> originalToSimplifiedMap)
  {
    RTree rTree = new RTree();
    for (int i = 0; i < lines.Count; i++)
    {
      rTree.Insert(lines[i].From, i);
      rTree.Insert(lines[i].To, -i - 1);
    }

    Dictionary<Point3d, Point3d> pointMap = new Dictionary<Point3d, Point3d>();
    HashSet<Point3d> anchors = new HashSet<Point3d>(anchorPoints);
    object lockObject = new object();

    originalToSimplifiedMap = new List<int>();

    Parallel.ForEach(lines, line =>
      {
      ProcessPoint(line.From, rTree, radius, lines, anchors, anchorAsMergeOnly, pointMap, lockObject);
      ProcessPoint(line.To, rTree, radius, lines, anchors, anchorAsMergeOnly, pointMap, lockObject);
      });

    List<Line> simplifiedLines = new List<Line>();
    for (int i = 0; i < lines.Count; i++)
    {
      var line = lines[i];
      Point3d start = pointMap.ContainsKey(line.From) ? pointMap[line.From] : line.From;
      Point3d end = pointMap.ContainsKey(line.To) ? pointMap[line.To] : line.To;

      if (!start.Equals(end))
      {
        simplifiedLines.Add(new Line(start, end));
        originalToSimplifiedMap.Add(i);  // Store the index of the original line
      }
    }

    return simplifiedLines;
  }

  public void ProcessPoint(Point3d pt, RTree rTree, double radius, List<Line> lines, HashSet<Point3d> anchors, bool anchorAsMergeOnly, Dictionary<Point3d, Point3d> pointMap, object lockObj)
  {
    if (!anchorAsMergeOnly && anchors.Contains(pt))
      return;

    List<Point3d> neighboringPoints = new List<Point3d>();

    // R-tree search callback
    EventHandler<RTreeEventArgs> searchCallback = (sender, args) =>
      {
      int id = args.Id;
      Point3d searchPoint = (id >= 0) ? lines[id].From : lines[-id - 1].To;

      if (anchorAsMergeOnly)
      {
        if (anchors.Contains(searchPoint))
          neighboringPoints.Add(searchPoint);
      }
      else
      {
        if (!anchors.Contains(searchPoint))
          neighboringPoints.Add(searchPoint);
      }
      };

    // Search R-tree within the radius
    rTree.Search(new Sphere(pt, radius), searchCallback);

    if (neighboringPoints.Count > 0)
    {
      Point3d mergePoint = anchorAsMergeOnly ? neighboringPoints[0] : CalculateCentroid(neighboringPoints); // Use first anchor as merge point or centroid

      lock (lockObj)  // Ensure thread safety when updating shared data
      {
        foreach (var neighbor in neighboringPoints)
        {
          if (!pointMap.ContainsKey(neighbor))
          {
            pointMap[neighbor] = mergePoint;
          }
        }
        if (!pointMap.ContainsKey(pt)) // Include the current processing point if not already mapped
        {
          pointMap[pt] = mergePoint;
        }
      }
    }
  }

  public Point3d CalculateCentroid(List<Point3d> points)
  {
    double x = 0, y = 0, z = 0;
    foreach (var point in points)
    {
      x += point.X;
      y += point.Y;
      z += point.Z;
    }
    int count = points.Count;
    return new Point3d(x / count, y / count, z / count);
  }
# ---------- end networksmooth_c ----------
duplicatelines_c = CSharpScript(lines=networksmooth_c.Ns)  # -> out, uniqueLinesOut, duplicateIndicesOut; inputs lines: list of Line; same code as duplicatelines_c
cull_index = CullIndex(List=networksmooth_c.OriginalToSimplifiedMap, Indices=duplicatelines_c.duplicateIndicesOut, Wrap=True)
ns = Line(duplicatelines_c.uniqueLinesOut)
integer = Integer(cull_index)
network_smooth = ClusterOutput(ns)
segments_index = ClusterOutput(integer)

# ==== cluster NetworkDetectChanges
lines_old = ClusterInput()
lines_new = ClusterInput()
resolution = ClusterInput()
return_geometry = ClusterInput()
linesbefore = Line(flatten(lines_old))
linesafter = Line(flatten(lines_new))
returngeo = Boolean(return_geometry)
resolution_2 = Number(resolution)
c_detectchanges = CSharpScript(LinesBefore=linesbefore, LinesAfter=linesafter, Resolution=resolution_2, ReturnGeo=returngeo)  # -> out, Unchanged, Added, Removed; inputs LinesBefore: list of Line, LinesAfter: list of Line, Resolution: Double, ReturnGeo: Boolean
# ---------- c_detectchanges: C# ----------
using System;
using System.Linq;
using System.Collections;
using System.Collections.Generic;
using System.Drawing;

using Rhino;
using Rhino.Geometry;

using Grasshopper;
using Grasshopper.Kernel;
using Grasshopper.Kernel.Data;
using Grasshopper.Kernel.Types;

public class Script_Instance : GH_ScriptInstance
{
    private (int roundingRes, double scalar) CalculateRoundingParameters(double resolution)
    {
        if (resolution <= 0)
            throw new ArgumentException("Resolution must be greater than 0");

        int roundingRes;
        if (resolution <= 0.01)
            roundingRes = 4;
        else if (resolution <= 0.1)
            roundingRes = 3;
        else if (resolution <= 1)
            roundingRes = 2;
        else
            roundingRes = 1;

        double scalar = roundingRes > 1 ? Math.Pow(10, roundingRes - 1) : 10;
        return (roundingRes, scalar);
    }

    private List<double> TransformPoint(Point3d point, double resolution, int roundingRes, double scalar)
    {
        return new List<double>
        {
            Math.Round(point.X / resolution, roundingRes) * scalar,
            Math.Round(point.Y / resolution, roundingRes) * scalar,
            Math.Round(point.Z / resolution, roundingRes) * scalar
        };
    }

    private GH_Path TransformPointToPath(Point3d point, double resolution, int roundingRes, double scalar)
    {
        var coords = TransformPoint(point, resolution, roundingRes, scalar);
        return new GH_Path((int)coords[0], (int)coords[1], (int)coords[2]);
    }

    private DataTree<object> CreateIndices(List<Line> lines, double resolution, int roundingRes, double scalar)
    {
        var indexedTree = new DataTree<object>();
        for (int i = 0; i < lines.Count; i++)
        {
            var line = lines[i];
            Point3d start = line.From;
            Point3d end = line.To;

            indexedTree.Add(i, TransformPointToPath(start, resolution, roundingRes, scalar));
            indexedTree.Add(i, TransformPointToPath(end, resolution, roundingRes, scalar));
        }
        return indexedTree;
    }

    private void RunScript(
	List<Line> LinesBefore,
	List<Line> LinesAfter,
	double Resolution,
	bool ReturnGeo,
	ref object Unchanged,
	ref object Added,
	ref object Removed)
    {
        // Validate inputs
        if (LinesBefore == null || LinesAfter == null || !LinesBefore.Any() || !LinesAfter.Any())
        {
            Component.AddRuntimeMessage(GH_RuntimeMessageLevel.Error, "Input line lists cannot be empty");
            return;
        }

        var (roundingRes, scalar) = CalculateRoundingParameters(Resolution);

        List<object> added = new List<object>();
        List<object> removed = new List<object>();
        List<object> unchanged = new List<object>();
        bool[] beforeToCheck = Enumerable.Repeat(true, LinesBefore.Count).ToArray();

        // Create indexed trees
        var indexedBefore = CreateIndices(LinesBefore, Resolution, roundingRes, scalar);
        var indexedAfter = CreateIndices(LinesAfter, Resolution, roundingRes, scalar);

        // Compare geometry
        for (int i = 0; i < LinesAfter.Count; i++)
        {
            var line = LinesAfter[i];
            bool curveExisted = false;

            try
            {
                var fromPath = TransformPointToPath(line.From, Resolution, roundingRes, scalar);
                var toPath = TransformPointToPath(line.To, Resolution, roundingRes, scalar);

                var idStart = indexedBefore.Branch(fromPath);
                var idEnd = indexedBefore.Branch(toPath);

                if (idStart != null && idEnd != null)
                {
                    foreach (var startId in idStart)
                    {
                        if (startId != null && idEnd.Contains(startId))
                        {
                            curveExisted = true;
                            beforeToCheck[Convert.ToInt32(startId)] = false;
                            break;
                        }
                    }
                }
            }
            catch (Exception e)
            {
                Component.AddRuntimeMessage(GH_RuntimeMessageLevel.Warning, $"Error processing line {i}: {e.Message}");
                continue;
            }

            if (curveExisted)
                unchanged.Add(ReturnGeo ? line : i);
            else
                added.Add(ReturnGeo ? line : i);
        }

        // Find removed geometry
        for (int i = 0; i < beforeToCheck.Length; i++)
        {
            if (beforeToCheck[i])
                removed.Add(ReturnGeo ? LinesBefore[i] : i);
        }

        // Set outputs
        Added = added;
        Removed = removed;
        Unchanged = unchanged;
    }
}
# ---------- end c_detectchanges ----------
panel = Panel(c_detectchanges.out)
linesunchanged = Line(c_detectchanges.Unchanged)
linesadded = Line(c_detectchanges.Added)
linesremoved = Line(c_detectchanges.Removed)
lines_unchanged = ClusterOutput(linesunchanged)
lines_removed = ClusterOutput(linesremoved)
lines_added = ClusterOutput(linesadded)

# ==== cluster NetworkDeadEnds: Delete cul-de-sacs in the Network
network = ClusterInput()
iterations = ClusterInput()
maximum_length = ClusterInput()
line = Line(network)
integer = Integer(iterations)
number = Number(maximum_length)
list_length = ListLength(List=line)
series = Series(Start=0, Step=1, Count=list_length)
c_dead_ends = CSharpScript(N=line, i=integer, l=number)  # -> out, Ci; inputs N: list of Line, i: Int32, l: Double
# ---------- c_dead_ends: C# ----------
using System;
using System.Collections;
using System.Collections.Generic;

using Rhino;
using Rhino.Geometry;

using Grasshopper;
using Grasshopper.Kernel;
using Grasshopper.Kernel.Data;
using Grasshopper.Kernel.Types;
using System.Threading.Tasks;

public class Script_Instance : GH_ScriptInstance
{
  private void RunScript(List<Line> N, int i, double l, ref object Ci)
  {
    DeadEndIdentifier Di = new DeadEndIdentifier();
    //default iteration number is 0 meaning that the algorithm runs until no dead ends are left
    int iter;
    if(i > 0)
      iter = i;
    else
      iter = 0;

    // if l is 0 or negative, all dead ends will be identified regardless of length
    double maxLength = l;

    DataTree<int> result = Di.IdentifyDeadEnds(N, i, maxLength);
    
    // If no dead ends were found, create a tree with all line indices
    if(result.BranchCount == 0)
    {
      result = new DataTree<int>();
      GH_Path path = new GH_Path(0);
      for(int idx = 0; idx < N.Count; idx++)
      {
        result.Add(idx, path);
      }
    }
    
    Ci = result;
  }

  public class DeadEndIdentifier
  {
    public DataTree<int> IdentifyDeadEnds(List<Line> lines, int iterations, double maxLength)
    {
      DataTree<int> result = new DataTree<int>();
      HashSet<int> previouslyIdentifiedDeadEnds = new HashSet<int>();

      // Initialization
      RTree rTree = new RTree();
      for (int i = 0; i < lines.Count; i++)
      {
        rTree.Insert(lines[i].From, i);
        rTree.Insert(lines[i].To, i);
      }

      int iter = 0;
      bool foundAnyDeadEnds = false;
      
      while (true)
      {
        List<int> deadEndsThisIteration = new List<int>();

        foreach (Line line in lines)
        {
          int index = lines.IndexOf(line);

          // Skip lines that were identified in previous iterations
          if (previouslyIdentifiedDeadEnds.Contains(index))
            continue;

          bool isDeadEnd = false;
          bool isDisconnected = !IsConnectedToAnotherEndpoint(rTree, line.From, index) ||
                               !IsConnectedToAnotherEndpoint(rTree, line.To, index);
          
          if (isDisconnected)
          {
            // Only consider it a dead end if its length is less than maxLength
            // or if maxLength is 0 or negative (meaning no length restriction)
            if (maxLength <= 0 || line.Length <= maxLength)
            {
              isDeadEnd = true;
              foundAnyDeadEnds = true;
            }
          }

          if (isDeadEnd)
          {
            deadEndsThisIteration.Add(index);
          }
        }

        if (deadEndsThisIteration.Count == 0)
          break;

        // Append the results of this iteration to the corresponding branch in the DataTree
        GH_Path path = new GH_Path(iter);
        foreach (int index in deadEndsThisIteration)
        {
          result.Add(index, path);

          // Remove identified dead ends from the RTree for the next iteration
          rTree.Remove(lines[index].From, index);
          rTree.Remove(lines[index].To, index);

          // Add to the set of previously identified dead ends
          previouslyIdentifiedDeadEnds.Add(index);
        }

        iter++;

        if (iterations > 0 && iter >= iterations)
          break;
      }
      
      // If we didn't find any dead ends that meet our criteria, return empty tree
      // (The main script will handle converting this to a complete network)
      if (!foundAnyDeadEnds)
      {
        return new DataTree<int>();
      }
      
      return result;
    }

    private bool IsConnectedToAnotherEndpoint(RTree rTree, Point3d point, int excludeIndex)
    {
      bool isConnected = false;
      rTree.Search(new Sphere(point, 0.001), (sender, args) =>
      {
        if (args.Id != excludeIndex) isConnected = true;
      });

      return isConnected;
    }
  }
}
# ---------- end c_dead_ends ----------
integer_2 = Integer(series)
integer_3 = Integer(c_dead_ends.Ci)
list_length_2 = ListLength(List=flatten(c_dead_ends.Ci))
create_set = CreateSet(List=flatten(c_dead_ends.Ci))  # -> Set, Map
set_difference = SetDifference(SetA=flatten(integer_2), SetB=flatten(integer_3))
larger_than = LargerThan(FirstNumber=list_length_2, SecondNumber=Slider(0, range=0..100))  # -> LargerThan, OrEqualTo
equality = Equality(FirstNumber=list_length_2, SecondNumber=list_length)  # -> Equality, Inequality
list_item = ListItem(List=line, Index=flatten(create_set.Set), Wrap=True)
cull_i = CullIndex(List=line, Indices=flatten(create_set.Set), Wrap=True)
gate_and = GateAnd(A=equality.Equality, B=larger_than.LargerThan)
stream_filter = StreamFilter(Gate=equality.Equality, Stream0=set_difference, Stream1=integer_2)
stream_filter_2 = StreamFilter(Gate=gate_and, Stream0=cull_i, Stream1=list_item)
integer_4 = Integer(stream_filter)
segments_index = ClusterOutput(integer_4)
line_2 = Line(stream_filter_2)
panel = Panel(stream_filter)
network_2 = ClusterOutput(line_2)

# ==== cluster NetworkSubgraphs: Detect detached parts of the Network
network = ClusterInput()
clean_network = Line(network)
# Recognizes sub-graphs.
# in final network there should be only 1 sub graph
c_subgraphs = CSharpScript(N=clean_network)  # -> out, SubId, Total; inputs N: list of Line
# ---------- c_subgraphs: C# ----------
using System;
using System.Collections;
using System.Collections.Generic;
using Rhino;
using Rhino.Geometry;
using Grasshopper;
using Grasshopper.Kernel;
using Grasshopper.Kernel.Data;
using Grasshopper.Kernel.Types;
using System.Linq;
using System.Threading.Tasks;

public class Script_Instance : GH_ScriptInstance
{
    private void RunScript(List<Line> N, ref object SubId, ref object Total)
    {
        LineCluster lineClusterInstance = new LineCluster(N);
        lineClusterInstance.IdentifyClusters();

        List<int> clusterIndices = lineClusterInstance.Indices;
        int totalClusters = lineClusterInstance.TotalClusters;

        SubId = clusterIndices;
        Total = totalClusters;
    }

    public class LineCluster
    {
        private List<Line> lines;
        private Dictionary<int, List<int>> graph;
        private int[] indices;

        public List<int> Indices { get; private set; }
        public int TotalClusters { get; private set; }

        public LineCluster(List<Line> inputLines)
        {
            lines = inputLines;
            graph = new Dictionary<int, List<int>>();
            indices = new int[lines.Count];

            for (int i = 0; i < lines.Count; i++)
            {
                graph[i] = new List<int>();
            }
        }

        public bool IsConnected(Line a, Line b)
        {
            const double tolerance = 1e-6;
            return a.From.DistanceTo(b.From) < tolerance ||
                   a.From.DistanceTo(b.To) < tolerance ||
                   a.To.DistanceTo(b.From) < tolerance ||
                   a.To.DistanceTo(b.To) < tolerance;
        }

        public void BuildGraph()
        {
            // Consider using parallel processing for large datasets
            Parallel.For(0, lines.Count, i =>
            {
                var localConnections = new List<int>();
                for (int j = i + 1; j < lines.Count; j++)
                {
                    if (IsConnected(lines[i], lines[j]))
                    {
                        lock (graph)
                        {
                            graph[i].Add(j);
                            graph[j].Add(i);
                        }
                    }
                }
            });
        }

        // Iterative DFS implementation using a stack
        private void IterativeDFS(int startNode, int clusterIndex)
        {
            var stack = new Stack<int>();
            stack.Push(startNode);

            while (stack.Count > 0)
            {
                int currentNode = stack.Pop();
                
                // Skip if already visited
                if (indices[currentNode] != -1)
                    continue;

                indices[currentNode] = clusterIndex;

                // Add unvisited neighbors to stack
                foreach (int neighbor in graph[currentNode])
                {
                    if (indices[neighbor] == -1)
                    {
                        stack.Push(neighbor);
                    }
                }
            }
        }

        public void IdentifyClusters()
        {
            BuildGraph();
            
            // Initialize all indices to -1
            for (int i = 0; i < indices.Length; i++)
            {
                indices[i] = -1;
            }

            int clusterIndex = 0;

            // Use iterative DFS for each unvisited node
            for (int node = 0; node < lines.Count; node++)
            {
                if (indices[node] == -1)
                {
                    IterativeDFS(node, clusterIndex);
                    clusterIndex++;
                }
            }

            Indices = indices.ToList();
            TotalClusters = clusterIndex;
        }
    }
}
# ---------- end c_subgraphs ----------
nr_of_subgraphs = Panel(c_subgraphs.Total)
create_set = CreateSet(List=c_subgraphs.SubId)  # -> Set, Map
expression = Expression(Expression="Format(\"Fail: There are {0} Subgraphs. \", x)")
member_index = MemberIndex(Set=c_subgraphs.SubId, Member=create_set.Set)  # -> Index, Count
number = Number(c_subgraphs.Total)
larger_than = LargerThan(FirstNumber=number, SecondNumber=Slider(1, range=0..1))  # -> LargerThan, OrEqualTo
tree_statistics = TreeStatistics(Tree=member_index.Index)  # -> Paths, Length, Count
number_slider = Slider(0, range=0..100)
sort_list = SortList(Keys=member_index.Count, ValuesValuesA=tree_statistics.Paths)  # -> Keys, ValuesValuesA
concatenate = Concatenate(FragmentA=expression, FragmentB="Passing largest one")
list_item = ListItem(List=reverse(sort_list.ValuesValuesA), Index=number_slider, Wrap=True)
cull_index = CullIndex(List=reverse(sort_list.ValuesValuesA), Indices=number_slider, Wrap=True)
stream_filter = StreamFilter(Gate=larger_than.LargerThan, Stream0="Pass: There are no Subgraphs", Stream1=concatenate)
tree_branch = TreeBranch(Tree=member_index.Index, Path=list_item, MaintainPaths=True)
tree_branch_2 = TreeBranch(Tree=member_index.Index, Path=cull_index, MaintainPaths=True)
list_item_2 = ListItem(List=clean_network, Index=tree_branch_2, Wrap=True)
list_item_3 = ListItem(List=clean_network, Index=tree_branch, Wrap=True)
maingraph = Line(list_item_3)
line = Line(list_item_2)
text = Text(stream_filter)
report = ClusterOutput(text)
main_graph = ClusterOutput(maingraph)
sub_graph = ClusterOutput(line)
